# Dynamo custom node Read Excel Into Lists.dyf (Dynamo 0.8.2.2371)
# category: Bakery.Excel

path = Input()
fromPath = FileObject(path)  # "File.FromPath"
sheetName = Input(sheetName : string)
code_block = CodeBlock { false; }
readFromFile = Excel.ReadFromFile(file=fromPath, sheetName=sheetName, readAsStrings=code_block)
string = StringInput("")
replaceNulls = Lists.Manage.ReplaceNulls(readFromFile, string)
watch = Watch(replaceNulls)
firstItem = List.FirstItem(watch)
headings = Output(firstItem)
code_block_2 = CodeBlock { 1; }
dropItems = List.DropItems(list=watch, amount=code_block_2)
data = Output(dropItems)
